# Grasshopper definition mhsqr.gh (Grasshopper 1.0.7)

crv = Curve(<curve referenced from the Rhino model>)
explode = Explode(Curve=crv, Recursive=True)  # -> Segments, Vertices
hframe = HorizontalFrame(Curve=reparameterize(explode.Segments), Parameter=Slider(0.5, range=0..1))
crv_2 = Curve(crv)
prot = RotatePlane(Plane=hframe, Angle=0)
crv_3 = Curve(reparameterize(<curve referenced from the Rhino model>))
explode_2 = Explode(Curve=crv_3, Recursive=True)  # -> Segments, Vertices
crv_4 = Curve(crv_3)
hframe_2 = HorizontalFrame(Curve=reparameterize(explode_2.Segments), Parameter=Slider(0.5, range=0..1))
bbox = BoundingBox(Content=crv_3, Plane=PlaneXY(0, 0, 0))  # -> Box, Box_2
prot_2 = RotatePlane(Plane=hframe_2, Angle=0)
number_slider = Slider(6, range=1..10)
dom = ConstructDomain(DomainStart=expr("-x", number_slider), DomainEnd=number_slider)
number_slider_2 = Slider(6, range=1..10)
dom_2 = ConstructDomain(DomainStart=expr("-x", number_slider_2), DomainEnd=number_slider_2)
rectangle = Rectangle(Plane=PlaneXY(0, 0, 0), XSize=dom_2, YSize=Slider(2.35, range=1..11), Radius=0)  # -> Rectangle, Length
hframe_3 = HorizontalFrame(Curve=reparameterize(rectangle.Rectangle), Parameter=Slider(0.875, range=0..1))
orient = Orient(Geometry=rectangle.Rectangle, Source=hframe_3, Target=graft(prot_2))  # -> flatten(Geometry), Transform
rdiff = RegionDifference(CurvesA=crv_4, CurvesB=orient.Geometry)
rectangle_2 = Rectangle(Plane=PlaneXY(0, 0, 0), XSize=dom, YSize=Slider(2.35, range=1..11), Radius=0)  # -> Rectangle, Length
hframe_4 = HorizontalFrame(Curve=reparameterize(rectangle_2.Rectangle), Parameter=Slider(0.875, range=0..1))
orient_2 = Orient(Geometry=rectangle_2.Rectangle, Source=hframe_4, Target=graft(prot))  # -> flatten(Geometry), Transform
rdiff_2 = RegionDifference(CurvesA=crv_2, CurvesB=orient_2.Geometry)
arrrec = RectangularArray(Geometry=rdiff_2, Cell=crv, XCount=Slider(5, range=0..20), YCount=Slider(5, range=0..20))  # -> Geometry, Transform
arrrec_2 = RectangularArray(Geometry=rdiff, Cell=bbox.Box, XCount=Slider(5, range=0..20, expression="X"), YCount=Slider(5, range=0..20))  # -> Geometry, Transform

number_slider_3 = Slider(6, range=1..10)

dom_3 = ConstructDomain(DomainStart=expr("-x", number_slider_3), DomainEnd=number_slider_3)
cir = Circle(Plane=PlaneXY(0, 0, 0), Radius=Slider(25, range=0..100))
rectangle_3 = Rectangle(Plane=PlaneXY(0, 0, 0), XSize=dom_3, YSize=Slider(2.35, range=1..11), Radius=0)  # -> Rectangle, Length
series = Series(Start=0, Step=0.1666666667, Count=6)
number_slider_4 = Slider(6, range=1..10)
hframe_5 = HorizontalFrame(Curve=reparameterize(cir), Parameter=series)
number_slider_5 = Slider(25, range=0..100)
number_slider_6 = Slider(25, range=0..100)
bbox_2 = BoundingBox(Content=cir, Plane=PlaneXY(0, 0, 0))  # -> Box, Box_2
hframe_6 = HorizontalFrame(Curve=reparameterize(rectangle_3.Rectangle), Parameter=Slider(0.377, range=0..1))
crv_5 = Curve(cir)
prot_3 = RotatePlane(Plane=hframe_5, Angle=0)
orient_3 = Orient(Geometry=rectangle_3.Rectangle, Source=hframe_6, Target=graft(prot_3))  # -> flatten(Geometry), Transform
dom_4 = ConstructDomain(DomainStart=expr("-x", number_slider_4), DomainEnd=number_slider_4)
dom_5 = ConstructDomain(DomainStart=expr("-x", number_slider_5), DomainEnd=number_slider_5)
dom_6 = ConstructDomain(DomainStart=expr("-x", number_slider_6), DomainEnd=number_slider_6)
rdiff_3 = RegionDifference(CurvesA=crv_5, CurvesB=orient_3.Geometry)
rectangle_4 = Rectangle(Plane=PlaneXY(0, 0, 0), XSize=dom_4, YSize=Slider(2.35, range=1..11), Radius=0)  # -> Rectangle, Length
rectangle_5 = Rectangle(Plane=PlaneXY(0, 0, 0), XSize=dom_5, YSize=dom_6, Radius=0)  # -> Rectangle, Length
arrrec_3 = RectangularArray(Geometry=rdiff_3, Cell=bbox_2.Box, XCount=Slider(5, range=0..20), YCount=Slider(5, range=0..20))  # -> Geometry, Transform
explode_3 = Explode(Curve=rectangle_5.Rectangle, Recursive=True)  # -> Segments, Vertices
hframe_7 = HorizontalFrame(Curve=reparameterize(explode_3.Segments), Parameter=Slider(0.5, range=0..1))
hframe_8 = HorizontalFrame(Curve=reparameterize(rectangle_4.Rectangle), Parameter=Slider(0.875, range=0..1))
prot_4 = RotatePlane(Plane=hframe_7, Angle=0)
orient_4 = Orient(Geometry=rectangle_4.Rectangle, Source=hframe_8, Target=prot_4)  # -> flatten(Geometry), Transform
crv_6 = Curve(rectangle_5.Rectangle)
rdiff_4 = RegionDifference(CurvesA=crv_6, CurvesB=orient_4.Geometry)
arrrec_4 = RectangularArray(Geometry=rdiff_4, Cell=rectangle_5.Rectangle, XCount=Slider(5, range=0..20), YCount=Slider(5, range=0..20))  # -> Geometry, Transform
