# Grasshopper definition 3dprintarc.gh (Grasshopper 1.0.7)

pt = ConstructPoint(XCoordinate=Slider(0, range=0..200, expression="-x"), YCoordinate=Slider(180, range=0..200), ZCoordinate=0)
pt_2 = ConstructPoint(XCoordinate=Slider(180, range=0..200, expression="-x"), YCoordinate=Slider(0, range=0..200), ZCoordinate=0)
box = Box2Pt(PointA=pt_2, PointB=pt, Plane=PlaneXY(0, 0, 0))
pop2d = Populate2D(Region=box, Count=Slider(170, range=0..300), Seed=1, Points=Point(-156.192889, 179.9726003, 0))
Z = UnitZ(Factor=Slider(5, range=0..10))
voronoi = Voronoi(Points=pop2d, Boundary=box, BruteForceOverride=False)
area = Area(Geometry=voronoi)  # -> Area, Centroid
offset = OffsetCurve(Curve=voronoi, Distance=expr("-x", Slider(1.2, range=0..10)), Plane=PlaneXY(0, 0, 0), Corners=1)
scale = Scale(Geometry=voronoi, Center=area.Centroid, Factor=Slider(0.417, range=0..10))  # -> Geometry, Transform
Z_2 = UnitZ(Factor=Slider(8, range=0..10))
extr = Extrude(Base=box, Direction=Z)
extr_2 = Extrude(Base=offset, Direction=Z_2)  # -> flatten(Extrusion)
cap = CapHoles(Brep=extr_2)
sdiff = SolidDifference(BrepsA=extr, BrepsB=cap)
srf = Surface([<surface referenced from the Rhino model> x4])
scale_2 = Scale(Geometry=sdiff, Center=Point(0, 0, 0), Factor=0.5)  # -> Geometry, Transform
box_2 = Box(scale_2.Geometry)
srfmorph = SurfaceMorph(
    Geometry=scale_2.Geometry,
    Reference=box_2,
    Surface=reparameterize(srf),
    UDomain=Slider(1, range=-0.2..1),
    VDomain=Slider(1, range=0..1),
    WDomain=Slider(2, range=0..10))
